# Grasshopper definition belt.gh (Grasshopper 1.0.7)

pressure = Slider(66.762, range=0..150)
expression = Expression(x=pressure, Expression="If(x > 100, (x-100)/10, 0 )")
expression_2 = Expression(x=pressure, Expression="If (x<50, (50-x)/10, 0)")
expression_3 = Expression(x=expression, y=expression_2, Expression="10+x-y")
Z = UnitZ(Factor=Slider(2.45, range=0..5))
cir = Circle(Plane=PlaneXY(0, 0, 0), Radius=expression_3)
extr = Extrude(Base=cir, Direction=Z)
number_slider = Slider(0.287, range=0..1)
offset = OffsetSurface(Surface=extr, Distance=number_slider, Retrim=True)
_1 = Number(1)
_1_2 = Number(1)
sdivide = DivideSurface(Surface=offset, UCount=_1, VCount=_1_2)  # -> Points, Normals, Parameters
flatten = FlattenTree(Tree=sdivide.Points, Path="{0}")
panel = Panel(flatten)
number_slider_2 = Slider(1, range=0..1)
addition = Addition(A=number_slider, B=number_slider_2)
number_slider_3 = Slider(0.25, range=0..1)
item = ListItem(List=panel, Index=0, Wrap=True)
neg = Negative(Value=addition)
cir_2 = Circle(Plane=item, Radius=number_slider_2)
vec = VectorXYZ(XComponent=addition, YComponent=Slider(0, range=0..1), ZComponent=Slider(0, range=0..1))  # -> Vector, Length
vec_2 = VectorXYZ(XComponent=neg, YComponent=number_slider_3, ZComponent=number_slider_3)  # -> Vector, Length
move = Move(Geometry=cir_2, Motion=vec.Vector)  # -> Geometry, Transform
move_2 = Move(Geometry=cir_2, Motion=vec_2.Vector)  # -> Geometry, Transform
Z_2 = UnitZ(Factor=Slider(2.45, range=0..5))
extr_2 = Extrude(Base=move_2.Geometry, Direction=Z_2)
extr_3 = Extrude(Base=move.Geometry, Direction=Z_2)
cap = CapHoles(Brep=extr_3)
cap_2 = CapHoles(Brep=extr_2)
